test file "Mode_Logic_TC"
  coverage: Decision, MCDC, Condition

suite "Mode_Logic"

  case "Mode_Logic_TestSequence" [simulation]
    model Mode_Logic, harness Mode_Logic_Harness1
    assessment "Regenerative Behaviour": At any point of time, if Brake >= FivePercent becomes true then, with no delay, MotorEnable == True must be true
    assessment "Low Charge Engine Active": At any point of time, if GeneratorEnable == True & EngineEnable == True becomes true then, with no delay, MotorEnable == False must be true
      Brake: signal Mode_Logic_Harness1/Mode_Logic|Mode_Logic/brake, port 1
      GeneratorEnable: signal Mode_Logic_Harness1/Mode_Logic|Mode_Logic/Mode_Logic, port 2
      False: expression 0
      EngineEnable: signal Mode_Logic_Harness1/Mode_Logic|Mode_Logic/Mode_Logic, port 3
      MotorEnable: signal Mode_Logic_Harness1/Mode_Logic|Mode_Logic/Mode_Logic, port 1
      True: expression 1
      FivePercent: expression 0.05

  case "Mode_Logic_ExcelImport" [baseline]
    model Mode_Logic, harness Mode_Logic_Harness2
    parameter set "ModelLogic_TestScenario.xlsx":
      HEV_Param =  % base workspace
        HEV_Param.Control = struct;
        HEV_Param.Control.Engine_Start_RPM = 700;
        HEV_Param.Control.Engine_Stop_RPM = 690;
    input "InputScenario_And_Parameters" from ModelLogic_TestScenario.xlsx, mapped to Speed -> speed, Brake -> brake, Charge -> charge, EngSpeed -> engine_speed (active)
    baseline "baseline_output"
      Mot_Enable
      Gen_Enable
      ICE_Enable